# Grasshopper definition SD_Client_UI_v4_iterativeInpainting.gh (Grasshopper 1.0.7)
# plug-ins: Human UI, Human, AviaryMacawGH

# ---- group: call stable diffusion API
# Stable Diffusion
boolean_toggle = BooleanToggle(False)
panel = Panel()
panel_2 = Panel()
ghpython_script = GhPythonScript(
    run=boolean_toggle,
    prompt=panel_2,
    negative_prompt=panel,
    promptStrength=Slider(0.1, range=0.1..9.99),
    steps=Slider(40, range=0..100),
    guidance=Slider(20, range=1..20),
    seed=Slider(40, range=0..100),
    authToken="...")  # -> res, log
# ---------- ghpython_script: Python ----------
__author__ = "DueringS"
__version__ = "2022.10.30"

import rhinoscriptsyntax as rs
import scriptcontext as sc
from System.Net import WebRequest
from System.IO import StreamReader
from System.Net import WebClient
from System.Text import Encoding
from System.Drawing import Bitmap
from clr import GetClrType as typeof
import Rhino
import System
import json
import time

if run == None:
    run = False

# create global variable to collect error messages & results
if "resultImage" not in sc.sticky.keys():
    sc.sticky["resultImage"] = None
    
if "API_log" not in sc.sticky.keys():
    sc.sticky["API_log"] = []

img2imgVersion = "15a3689ee13b0d2616e98820eca31d4c3abcd36672df6afce5cb6feb1d66087d"
inpaintingVersion = "e5a34f913de0adc560d20e002c45ad43a80031b62caacc3d84010c6b6a64870c"
txt2imgVersion = "6359a0cab3ca6e4d3320c33d79096161208e9024d174b2311e5a21b6c7e1131c"

def screenCap(viewPortName, i_w=512, i_h=512):
    maximizedID = None
    allVP = Rhino.RhinoDoc.ActiveDoc.Views.GetViewList(True, False)
    targetVP = None
    for i, vp in enumerate(allVP):
        if vp.ActiveViewport.Name == viewPortName:
            print i
            targetVP = vp
        if vp.Maximized == True:
            maximizedID = i
    if targetVP == None:
        print "asd"
        targetVP = allVP[0] 
    imageDim = System.Drawing.Size(i_w, i_h)
    
    idd = Rhino.Display.DisplayModeDescription.Id
    dm = Rhino.Display.DisplayModeDescription.GetDisplayModes()

    # get prefered render mode
    for obj in dm:
        if obj.LocalName == 'Rendered':
            dm = obj
    imageCap = targetVP.CaptureToBitmap(imageDim)#Rhino.Display.RhinoView.CaptureToBitmap(cam_view, imageDim, dm)
    if maximizedID != None:
        allVP[maximizedID].Maximized = True
    
    return imageCap

def convertBM(bm):
    # encodes bitmap to b64
    converter = System.Drawing.ImageConverter()
    bytes_ = converter.ConvertTo(bm, typeof(System.Array[System.Byte]))
    imageB64 = System.Convert.ToBase64String(
        bytes_,
        System.Base64FormattingOptions.None)
    return imageB64

def UrlOpen(uri, parameters=None):
    request = WebRequest.Create(uri)
    request.Timeout = 2500
    
    if parameters is not None:
        print parameters
        
        request.ContentType = "application/json"
        request.Accept = "*/*"
        request.Method = "POST"   
        request.Headers.Add("Authorization: Token {token}".format(token=authToken))
        bytes = Encoding.ASCII.GetBytes(parameters)
        request.ContentLength = bytes.Length
        reqStream = request.GetRequestStream()
        reqStream.Write(bytes, 0, bytes.Length)
        reqStream.Close()
    response = request.GetResponse()
    responseTxt = StreamReader(response.GetResponseStream()).ReadToEnd()
    respJson = json.loads(str(responseTxt))
    resURL = respJson["urls"]["get"]
    
    # fetch inference result once its finished
    
    time.sleep(3.5) # inference takes at least 4s
    inferenceFinished = False
    maxCnt = 50
    cnt =0
    logCollection = []
    while not inferenceFinished and cnt <= maxCnt:
        awnserURL = resURL
        requestResult = WebRequest.Create(awnserURL)
        requestResult.Timeout = 35000
        requestResult.ContentType = "application/json"
        requestResult.Method = "GET"   #not work for get method
        requestResult.Headers.Add("Authorization: Token {token}".format(token=authToken))
        reqResultStream = requestResult.GetResponse()
        resultResult = StreamReader(reqResultStream.GetResponseStream()).ReadToEnd()
        respJson = json.loads(str(resultResult))
        if respJson["completed_at"] != None:
            inferenceFinished = True
        print("inference in progress...")
        cnt += 1
        time.sleep(0.2)
    sc.sticky["API_log"].append(str(time.time()) + "----- errors:" + str(respJson["error"]))
    if cnt >= maxCnt:
        log = "time out"
        sc.sticky["API_log"].append("time out")
    try:
        print "hello"
        imgURL =  respJson["output"][0]
        # get result image
        client =  WebClient()
        stream = client.OpenRead(imgURL)
        bm = Bitmap(stream)
        return bm
    except:
        return "an error occured"
    
    return bm


# choose best suiting model version
print("initImage: ", initImage, "maskImage: ", maskImage)
version = txt2imgVersion
if initImage != None:
    version = img2imgVersion
if maskImage != None:
    version= inpaintingVersion

# assemble model instruction and input data ------------------------------------
requestContent = {"version": version}
modelInput = {"prompt":prompt}
if initImage != None:
    imgDims = initImage.Size
    modelInput["width"] = imgDims.Width
    modelInput["height"] = imgDims.Height
    b64IMG = "data:image/png;base64," + convertBM(initImage)
    modelInput["image"] = b64IMG
if maskImage != None and maskImage != "Null" and initImage != None:
    b64IMG_mask = "data:image/png;base64," + convertBM(maskImage)
    modelInput["mask"] = b64IMG_mask
if negative_prompt != None and negative_prompt != "":
     modelInput["negative_prompt"] = negative_prompt
if scheduler != None and scheduler != "":
    modelInput["scheduler"] = scheduler
if promptStrength != None:
    if promptStrength > 1:
        promptStrength = 1
    elif promptStrength <0.01:
        promptStrength= 0.01
    modelInput["prompt_strength"] = promptStrength
if steps != None:
    modelInput["num_inference_steps"] = steps
if guidance != None:
    if guidance < 1:
        guidance = 1
    elif guidance >20:
        guidance= 20
    modelInput["guidance_scale"] = guidance
if seed != None:
    modelInput["seed"] = seed

requestContent["input"] = modelInput
requestContentStr =  str(requestContent).replace("'", '"')

# run model
if run:
    sc.sticky["resultImage"] = UrlOpen("https://api.replicate.com/v1/predictions",requestContentStr)

res = sc.sticky["resultImage"]
log = sc.sticky["API_log"]
# ---------- end ghpython_script ----------

# ----
run = Button()
number_slider = Slider(512, range=0..1000)
threshold = Slider(60, range=0..100)

seed_integer_number = Slider(60, range=0..100)
create_toggle = CreateToggle(Default=True, Label="use image", OnLabel=" ", OffLabel=" ")
create_toggle_2 = CreateToggle(Default=True, Label="use mask   ", OnLabel=" ", OffLabel=" ")
create_toggle_3 = CreateToggle(Default=True, Label="random seed", OnLabel=" ", OffLabel=" ")
value_listener = ValueListener(Elements=create_toggle, SomeProperty=True)  # -> Values, Indices
value_listener_2 = ValueListener(Elements=create_toggle_2, SomeProperty=True)  # -> Values, Indices
value_listener_3 = ValueListener(Elements=create_toggle_3, SomeProperty=True)  # -> Values, Indices
create_slider = CreateSlider(Slider=seed_integer_number, ShowBounds=False, ShowTicks=False, ShowTooltip=False, ShowValLabel=True, showLabel=True)
value_listener_4 = ValueListener(Elements=create_slider, SomeProperty=True)  # -> flatten(Values), Indices
create_separator = CreateSeparator(Thickness=2, Horizontal=False, Color=RGB(207, 207, 207), Width=50, Height=60)
create_separator_2 = CreateSeparator(Thickness=2, Horizontal=False, Color=RGB(207, 207, 207), Width=50, Height=60)
manual_seed = Integer(value_listener_4.Values)
merge = Merge(Data1=create_toggle, Data2=create_separator, Data3=create_toggle_2, Data4=create_separator_2, Data5=create_toggle_3)
hide_show_element = HideShowElement(ElementToHideShow=create_slider, Show=invert(value_listener_3.Values), Collapse=True, Disable=False)
create_wrappanel = CreateWrapPanel(UIElements=merge, Horizontal=True)
create_view_box = CreateViewBox(UIElements=create_wrappanel, Width=Slider(200, range=0..200), Height=Slider(46, range=0..100))
merge_2 = Merge(Data1=create_view_box, Data2=create_slider)

panel_3 = Panel("""512
768
1024""")
panel_4 = Panel("""True
False
False""")
merge_3 = Merge(Data1=panel_4, Data2=panel_4)
merge_4 = Merge(Data1=panel_3, Data2=panel_3)
panel_5 = Panel("""width
width
width
height
height
height""")
create_radio_button = CreateRadioButton(RadioButtonName=merge_4, RadioButtonGroup=panel_5, InitiallySelected=merge_3)
panel_6 = Panel("""width
height""")
create_label = CreateLabel(LabelText=panel_6, LabelSize=12, Justification=0)
split_list = SplitList(List=create_radio_button, Index=Slider(3, range=0..10))  # -> ListA, ListB
create_stack = CreateStack(UIElements=split_list.ListA, Horizontal=False)
list_item = ListItem(List=create_label, Index=0, Wrap=True)  # -> Item, Item1
create_stack_2 = CreateStack(UIElements=split_list.ListB, Horizontal=False)
merge_5 = Merge(Data1=list_item.Item, Data2=create_stack)  # -> flatten(Result)
merge_6 = Merge(Data1=list_item.Item1, Data2=create_stack_2)  # -> flatten(Result)
value_listener_5 = ValueListener(Elements=split_list.ListA, SomeProperty=True)  # -> flatten(Values), flatten(Indices)
value_listener_6 = ValueListener(Elements=split_list.ListB, SomeProperty=True)  # -> flatten(Values), flatten(Indices)
create_separator_3 = CreateSeparator(Thickness=0.5, Horizontal=False, Color=RGB(0, 0, 0), Width=30, Height=4)
res = Data(panel_3)
create_stack_3 = CreateStack(UIElements=merge_6, Horizontal=False)
create_stack_4 = CreateStack(UIElements=merge_5, Horizontal=False)
cull_pattern = CullPattern(List=res, CullPattern=value_listener_6.Values)
cull_pattern_2 = CullPattern(List=res, CullPattern=value_listener_5.Values)
merge_7 = Merge(Data1=create_stack_4, Data2=create_separator_3, Data3=create_stack_3)
height = Integer(cull_pattern)
width = Integer(cull_pattern_2)
create_stack_5 = CreateStack(UIElements=flatten(merge_7), Horizontal=True)
adjust_element_positioning = AdjustElementPositioning(ElementsToAdjust=create_stack_5, AbsolutePositioning=False, HorizontalAlignment=1)

# ----
# screencap & mask
viewport_name = Data("Perspective")
width_2 = Data(number_slider)
height_2 = Data(number_slider)
threshold_2 = Data(threshold)
invertmask = Data(Toggle(False))
keycolor = Data(ColourSwatch(SwatchColor=RGB(255, 0, 0)))
run_2 = Data(run)
cluster = Cluster(y=run_2)

# ---- group: screen cap
ghpython_script_2 = GhPythonScript(vpName=viewport_name, width=width_2, height=height_2, trigger=cluster)  # -> image_out, mask_out; inputs width: Int32, height: Int32
# ---------- ghpython_script_2: Python ----------
__author__ = "DueringS"
__version__ = "2022.10.30"
import copy
import rhinoscriptsyntax as rs
import scriptcontext as sc
import Rhino
import System
import Rhino.RhinoDoc as rhDoc
import scriptcontext
from clr import GetClrType as typeof


def screenCap(viewPortName, i_w=512, i_h=512):
    maximizedID = None
    allVP = Rhino.RhinoDoc.ActiveDoc.Views.GetViewList(True, False)
    targetVP = None
    for i, vp in enumerate(allVP):
        if vp.ActiveViewport.Name == viewPortName:
            print i
            targetVP = vp
        if vp.Maximized == True:
            maximizedID = i
    print dir(allVP[0])
    if targetVP == None:
        print "asd"
        targetVP = allVP[0] 
    imageDim = System.Drawing.Size(i_w, i_h)
    
    idd = Rhino.Display.DisplayModeDescription.Id
    dm = Rhino.Display.DisplayModeDescription.GetDisplayModes()

    # get prefered render mode
    for obj in dm:
        if obj.LocalName == 'Rendered':
            dm = obj
                            
    imageCap = targetVP.CaptureToBitmap(imageDim)
    if maximizedID != None:
        allVP[maximizedID].Maximized = True
    
    return imageCap

def convertBM(bm):
    # encodes bitmap to b64
    converter = System.Drawing.ImageConverter()
    bytes_ = converter.ConvertTo(bm, typeof(System.Array[System.Byte]))
    imageB64 = System.Convert.ToBase64String(
        bytes_,
        System.Base64FormattingOptions.None)
    return imageB64

# ensure correct image size
if width != None:
    if width < 512:
        width = 512
    elif width >1024:
        width= 1024
else:
    width = 512

if height != None:
    if height > 768 and width > 1024:
        height = 768
    elif height > 1024:
        height = 1024
    elif height < 512:
        height= 512
else:
    height = 512

# handle IMG_MASK mode
sc.doc = rhDoc.ActiveDoc

maskImage = None
mainImage = None

curLayer = scriptcontext.doc.Layers.CurrentLayer

try:
    postProcessFlag = False
    if curLayer.Name == "IMG_MASK":
        postProcessFlag = True
        # create fake layer 
        dummyIndex = scriptcontext.doc.Layers.Add("justPassingBy", System.Drawing.Color.Black)
        # set dummy layer active 
        scriptcontext.doc.Layers.SetCurrentLayerIndex(dummyIndex, True)
    
    rs.LayerVisible("IMG_MASK",True)
    maskImage = screenCap(vpName,width,height)
    rs.LayerVisible("IMG_MASK",False)
    mainImage =screenCap(vpName,width,height)

    if postProcessFlag:
        scriptcontext.doc.Layers.SetCurrentLayerIndex(curLayer.Index, True)
        scriptcontext.doc.Layers.Delete(dummyIndex, True)
    rs.LayerVisible("IMG_MASK",True)
except:
    mainImage =screenCap(vpName,width,height)


image_out = mainImage
mask_out = maskImage
# ---------- end ghpython_script_2 ----------

# ---- group: create image mask
c_script = CSharpScript(img=ghpython_script_2.mask_out, threshold=threshold_2, keyColor=keycolor, invertMask=invertmask)  # -> Image_mask; inputs threshold: Int32, keyColor: Color, invertMask: Boolean
# ---------- c_script: C# usings ----------
using System.Drawing;
using System.Drawing.Drawing2D;
using System.Drawing.Imaging;
using System.IO;
using System.Linq;
# ---------- c_script: C# ----------
    // mask image by color, create black/white mask

    Image image = img as Image;
    // color filter
    int hr = (int) keyColor.R;
    int hg = (int) keyColor.G;
    int hb = (int) keyColor.B;

    int highR = hr + threshold;
    int lowR = hr - threshold;

    int highG = hg + threshold;
    int lowG = hg - threshold;

    int highB = hb + threshold;
    int lowB = hb - threshold;

    if (highR > 255){highR = 255;}
    if (lowR < 0){lowR = 0;}

    if (highG > 255){highG = 255;}
    if (lowG < 0){lowG = 0;}

    if (highB > 255){highB = 255;}
    if (lowB < 0){lowB = 0;}



    var imageAttr = new ImageAttributes();
    Color lowerColor = Color.FromArgb(lowR, lowG, lowB);
    Color upperColor = Color.FromArgb(highR, highG, highB);
    imageAttr.SetColorKey(
      lowerColor,
      upperColor,
      ColorAdjustType.Default
      );


    // Draw the image with the color key set.
    Rectangle rect = new Rectangle(0, 0, image.Width, image.Height);

    var output = new Bitmap(image.Width, image.Height);
    using (var gfx = Graphics.FromImage(output))
    {
      gfx.SmoothingMode = SmoothingMode.AntiAlias;
      gfx.DrawImage(
        image,
        new Rectangle(0, 0, image.Width, image.Height),
        0,
        0,
        image.Width,
        image.Height,
        GraphicsUnit.Pixel,
        imageAttr);

    }


    float[][] ptsArray = {
      new float[] {1.0f, 0, 0, 0, 0},
      new float[] {0, 1.0f, 0, 0, 0},
      new float[] {0, 0, 1.0f, 0, 0},
      new float[] {0, 0, 0, 1.0f, 0},
      new float[] {1.0f, 1.0f, 1.0f, 0, 1}};

    ImageAttributes imageAttributes = new ImageAttributes();
    imageAttributes.ClearColorMatrix();

    imageAttributes.SetColorMatrix(new ColorMatrix(ptsArray), ColorMatrixFlag.Default, ColorAdjustType.Bitmap);

    var outInverted = new Bitmap(output.Width, output.Height);
    Graphics g = Graphics.FromImage(outInverted);
    Rectangle background = new Rectangle(0, 0, image.Width, image.Height);
    g.FillRectangle(Brushes.Black, background);
    g.DrawImage(output,
      new Rectangle(0, 0, output.Width, output.Height),
      0,
      0,
      output.Width, output.Height,
      GraphicsUnit.Pixel,
      imageAttributes);

    if (invertMask != true){
        //Bitmap bmpInverted = outInverted; // your bitmap object
        ImageAttributes attrInvert = new ImageAttributes();
        ColorMatrix colorMatrix = new ColorMatrix(new float[][]
          {
          new float[] {-1, 0, 0, 0, 0},
          new float[] {0, -1, 0, 0, 0},
          new float[] {0, 0, -1, 0, 0},
          new float[] {0, 0, 0, 1, 0},
          new float[] {1, 1, 1, 0, 1}
          });
        attrInvert.SetColorMatrix(colorMatrix);
  
        Graphics gg = Graphics.FromImage(outInverted);
        {
          gg.DrawImage(outInverted, new Rectangle(0, 0, outInverted.Width, outInverted.Height),
            0, 0, outInverted.Width, outInverted.Height, GraphicsUnit.Pixel, attrInvert);
        }

     };
    
    Image_mask = outInverted;
# ---------- end c_script ----------

# ----
create_toggle_4 = CreateToggle(Default=False, Label="invert mask", OnLabel=" ", OffLabel=" ")
value_listener_7 = ValueListener(Elements=create_toggle_4, SomeProperty=True)  # -> Values, Indices

boolean_toggle_2 = BooleanToggle(True)
adj_image = BooleanToggle(True)
update_image = Button()
contrast = Slider(1.07, range=0.8..3)

geometry_pipeline = GeometryPipeline(
    GroupByLayer=False,
    GroupByType=False,
    IncludeHidden=True,
    IncludeLocked=True,
    LayerFilter="backgroundImage",
    NameFilter="*",
    SublayerFiltering=True,
    TypeFilter=1073741848)
geometry = Geometry(geometry_pipeline)

loadbm = GhPythonScript()  # -> bitmap
# ---------- loadbm: Python ----------
__author__ = "DueringS"
__version__ = "2021.08.19"

import rhinoscriptsyntax as rs
import System.Drawing.Bitmap as bm

bitmap = bm(imgPath)
# ---------- end loadbm ----------

manual_seed_2 = Integer(manual_seed)
seed_settings = Integer(value_listener_3.Values)
use_image_setting = Data(value_listener.Values)
use_mask_setting = Data(value_listener_2.Values)

# ---- group: manual seed
stream_gate = StreamGate(Stream=manual_seed_2, Gate=seed_settings)  # -> Target0, Target1

# ----
# Human UI
# paste your token here to keep it
# permanently in the file
# add quick style tags of your
#  choice here
strength = Slider(0.7, range=0.1..0.95)
guidiance = Slider(20, range=1..20)
steps = Slider(60, range=0..100)
panel_7 = Panel("""K_EULER
DDIM
DPMSolverMultistep""")
create_pulldown_menu = CreatePulldownMenu(Label="sampler", ListItems=panel_7, SelectedIndex=0, showLabel=True)
create_slider_2 = CreateSlider(Slider=strength, ShowBounds=False, ShowTicks=False, ShowTooltip=False, ShowValLabel=True, showLabel=True)
create_slider_3 = CreateSlider(Slider=guidiance, ShowBounds=False, ShowTicks=False, ShowTooltip=False, ShowValLabel=True, showLabel=True)
create_slider_4 = CreateSlider(Slider=steps, ShowBounds=False, ShowTicks=False, ShowTooltip=False, ShowValLabel=True, showLabel=True)
theshold = Slider(62, range=0..255)
panel_8 = Panel("path to stable-diffusion folder")  # disabled
paste_auth_token_here_to_keep_it_in_file = Panel("")
add_style_tags_here = Panel("""modernist
brutalist
Vienna
Newyork
Shanghai
Photography""")
get_gh_filepath = CSharpScript()  # -> A
# ---------- get_gh_filepath: C# ----------
A = GrasshopperDocument.FilePath;
# ---------- end get_gh_filepath ----------
panel_9 = Panel("stable-diffusion")  # disabled
merge_8 = Merge(Data1=create_slider_4, Data2=create_pulldown_menu)
ghpython_script_3 = GhPythonScript(x=get_gh_filepath)  # -> a
# ---------- ghpython_script_3: Python ----------
__author__ = "DueringS"
__version__ = "2022.10.09"

import rhinoscriptsyntax as rs

temp = x.split("\\")[-1]
a = x.replace(temp, "")
print a
# ---------- end ghpython_script_3 ----------
create_wrappanel_2 = CreateWrapPanel(UIElements=merge_8, Horizontal=True)
concatenate = Concatenate(FragmentA=ghpython_script_3, FragmentB=panel_9)  # disabled
panel_10 = Panel(concatenate)  # disabled
create_color_picker = CreateColorPicker(DefaultColor=ColourSwatch(SwatchColor=RGB(252, 0, 0)))
create_text_box = CreateTextBox(Label="viewport name", DefaultText="Perspective", UpdateButton=True, showLabel=True)
create_stack_6 = CreateStack(UIElements=[create_slider_2, create_slider_3], Horizontal=False)
create_view_box_2 = CreateViewBox(UIElements=create_wrappanel_2, Width=Slider(320, range=0..1000), Height=Slider(99, range=0..1000))
create_text_box_2 = CreateTextBox(Label=panel_8, DefaultText=panel_10, UpdateButton=True, showLabel=True)  # disabled
create_text_box_3 = CreateTextBox(Label="authentication token", DefaultText=paste_auth_token_here_to_keep_it_in_file, UpdateButton=True, showLabel=True)
create_text_box_4 = CreateTextBox(Label="neg. prompt", UpdateButton=True, showLabel=True)
create_text_box_5 = CreateTextBox(Label="prompt", DefaultText="pavilion", UpdateButton=True, showLabel=True)
create_button = CreateButton(ButtonName="run model!", ButtonStyle=0)
create_slider_5 = CreateSlider(Slider=theshold, ShowBounds=False, ShowTicks=False, ShowTooltip=False, ShowValLabel=True, showLabel=True)
create_toggle_5 = CreateToggle(Default=False, Label=add_style_tags_here, OnLabel="    ", OffLabel="    ")
ghpython_script_4 = GhPythonScript(x=add_style_tags_here)  # -> a
# ---------- ghpython_script_4: Python ----------
__author__ = "DueringS"
__version__ = "2022.10.13"

import rhinoscriptsyntax as rs
if x == "Photography":
    a = "Nikon, Canon"
else:
   a = x
# ---------- end ghpython_script_4 ----------
create_view_box_3 = CreateViewBox(UIElements=create_toggle_4, Width=50, Height=60)
value_listener_8 = ValueListener(Elements=create_pulldown_menu, SomeProperty=True)  # -> Values, Indices
value_listener_9 = ValueListener(Elements=create_slider_2, SomeProperty=True)  # -> Values, Indices
value_listener_10 = ValueListener(Elements=create_slider_4, SomeProperty=True)  # -> Values, Indices
value_listener_11 = ValueListener(Elements=create_slider_3, SomeProperty=True)  # -> Values, Indices
value_listener_12 = ValueListener(Elements=create_text_box_4, SomeProperty=True)  # -> flatten(Values), Indices
value_listener_13 = ValueListener(Elements=create_text_box_5, SomeProperty=True)  # -> flatten(Values), Indices
value_listener_14 = ValueListener(Elements=create_toggle_5, SomeProperty=True)  # -> flatten(Values), Indices
value_listener_15 = ValueListener(Elements=create_text_box, SomeProperty=True)  # -> Values, Indices
value_listener_16 = ValueListener(Elements=create_text_box_2, SomeProperty=True)  # -> Values, Indices; disabled
value_listener_17 = ValueListener(Elements=create_text_box_3, SomeProperty=True)  # -> Values, Indices
value_listener_18 = ValueListener(Elements=create_button, SomeProperty=True)  # -> Values, Indices
value_listener_19 = ValueListener(Elements=create_color_picker, SomeProperty=True)  # -> Values, Indices
value_listener_20 = ValueListener(Elements=create_slider_5, SomeProperty=True)  # -> Values, Indices
data_dam = DataDam(DataDataA=value_listener_10.Values, BufferDelay=20000000, BufferMode=2)
data_dam_2 = DataDam(DataDataA=value_listener_9.Values, BufferDelay=20000000, BufferMode=2)
data_dam_3 = DataDam(DataDataA=value_listener_11.Values, BufferDelay=20000000, BufferMode=2)
data_dam_4 = DataDam(DataDataA=value_listener_20.Values, BufferDelay=20000000, BufferMode=2)
data_dam_5 = DataDam(DataDataA=value_listener_19.Values, BufferDelay=10000000, BufferMode=2)
data_dam_6 = DataDam(DataDataA=value_listener_7.Values, BufferDelay=10000000, BufferMode=2)
create_wrappanel_3 = CreateWrapPanel(UIElements=[create_slider_5, create_view_box_3], Horizontal=True)
ghpython_script_5 = GhPythonScript(prompt=value_listener_13.Values, txt=ghpython_script_4, state=value_listener_14.Values)  # -> a; inputs txt: list, state: list
# ---------- ghpython_script_5: Python ----------
__author__ = "DueringS"
__version__ = "2022.10.09"

import rhinoscriptsyntax as rs

promptFinal = prompt

for i, t in enumerate(txt):
    if state[i] == True:
        promptFinal += ", " + t

a = promptFinal
# ---------- end ghpython_script_5 ----------
data_dam_7 = DataDam(DataDataA=width, BufferDelay=20000000, BufferMode=2)
data_dam_8 = DataDam(DataDataA=height, BufferDelay=20000000, BufferMode=2)
adjust_element_positioning_2 = AdjustElementPositioning(ElementsToAdjust=create_wrappanel_3, AbsolutePositioning=False, HorizontalAlignment=1)
create_wrappanel_4 = CreateWrapPanel(UIElements=create_toggle_5, Horizontal=True)
merge_9 = Merge(Data1=create_button)
panel_11 = Panel("""To use the image mask mode you have to create a layer with the name "IMG_MASK" and assing an "Emission" material to it, with a color that is easy to seperate from the rest of the scene (similar to how blue or green-screen work). 
Now, you can use geometry drawn on this layer to create the mask.""")
create_text_block = CreateTextBlock(Text=panel_11, TextSize=8, Justification=1)
create_view_box_4 = CreateViewBox(UIElements=create_wrappanel_4, Width=350, Height=60)
create_expander = CreateExpander(UIElements=create_text_box_3, Header="Auth. Token (keep it secret)", Open=False)
create_separator_4 = CreateSeparator(Thickness=0.5, Horizontal=True, Color=RGB(0, 0, 0), Width=300, Height=20)
create_separator_5 = CreateSeparator(Thickness=0.5, Horizontal=True, Color=RGB(33, 33, 33), Width=300, Height=50)
create_label_2 = CreateLabel(LabelText="Additional model Settings", LabelSize=12, Justification=1)
create_label_3 = CreateLabel(LabelText="Image Mask Settings", LabelSize=12, Justification=1)
merge_10 = Merge(
    Data1=create_expander,
    Data2=create_text_box,
    Data3=create_text_box_2,
    Data5=create_separator_4,
    Data6=create_label_2,
    Data8=create_stack_5,
    Data10=create_view_box_2,
    Data11=merge_2,
    Data12=create_separator_5,
    Data13=create_label_3,
    Data14=create_wrappanel_3,
    Data15=create_color_picker,
    Data16=create_text_block)
adjust_element_appearance = AdjustElementAppearance(ElementsToAdjust=merge_10, Foreground=RGB(0, 0, 0), Background=RGB(255, 255, 255), FontSize=12)
panel_12 = Panel("""model
settings""")

threshold_3 = Data(data_dam_4)
# Stable Diffusion + humanUI
run_3 = Data(value_listener_18.Values)
localdir = Data(ghpython_script_3)
prompts = Data(ghpython_script_5)
negprompt = Data(value_listener_12.Values)
promptstrength = Data(data_dam_2)
steps_2 = Data(data_dam)
sampler_scheudler = Data(value_listener_8.Values)
guidance = Data(data_dam_3)
viewport_name_2 = Data(value_listener_15.Values)
authtoken = Data(value_listener_17.Values)
invertmask_2 = Data(data_dam_6)
width_3 = Data(data_dam_7)
keycolor_2 = Data(data_dam_5)
height_3 = Data(data_dam_8)
localdir_2 = Data(localdir)
panel_13 = Panel(prompts)
panel_14 = Panel(negprompt)
panel_15 = Panel(viewport_name_2)
concatenate_2 = Concatenate(FragmentA=localdir_2, FragmentB="results")
run_4 = Data(run_3)

# ----
# screencap & mask
viewport_name_3 = Data(panel_15)
width_4 = Data(width_3)
height_4 = Data(height_3)
threshold_4 = Data(threshold_3)
invertmask_3 = Data(invertmask_2)
keycolor_3 = Data(keycolor_2)
run_5 = Data(run_3)
cluster_2 = Cluster(y=run_5)

# ---- group: screen cap
ghpython_script_6 = GhPythonScript(vpName=viewport_name_3, width=width_4, height=height_4, trigger=cluster_2)  # -> image_out, mask_out; inputs width: Int32, height: Int32; same code as ghpython_script_2

# ---- group: create image mask
c_script_2 = CSharpScript(img=ghpython_script_6.mask_out, threshold=threshold_4, keyColor=keycolor_3, invertMask=invertmask_3)  # -> Image_mask; inputs threshold: Int32, keyColor: Color, invertMask: Boolean; same code as c_script

# ---- group: mask gate
stream_gate_2 = StreamGate(Stream=c_script_2, Gate=use_mask_setting)  # -> Target0, Target1

# ---- group: img gate
stream_gate_3 = StreamGate(Stream=ghpython_script_6.image_out, Gate=use_image_setting)  # -> Target0, Target1

# ---- group: call SD model
ghpython_script_7 = GhPythonScript(
    run=run_4,
    prompt=panel_13,
    negative_prompt=panel_14,
    initImage=stream_gate_3.Target1,
    maskImage=stream_gate_2.Target1,
    promptStrength=promptstrength,
    steps=steps_2,
    guidance=guidance,
    seed=stream_gate.Target0,
    scheduler=sampler_scheudler,
    authToken=authtoken)  # -> res, log
# ---------- ghpython_script_7: Python ----------
__author__ = "DueringS"
__version__ = "2022.10.30"

import rhinoscriptsyntax as rs
import scriptcontext as sc
from System.Net import WebRequest
from System.IO import StreamReader
from System.Net import WebClient
from System.Text import Encoding
from System.Drawing import Bitmap
from clr import GetClrType as typeof
import Rhino
import System
import json
import time

if run == None:
    run = False


# create global variable to collect error messages & results
if "resultImage" not in sc.sticky.keys():
    sc.sticky["resultImage"] = None

if "API_log" not in sc.sticky.keys():
    sc.sticky["API_log"] = []

img2imgVersion = "15a3689ee13b0d2616e98820eca31d4c3abcd36672df6afce5cb6feb1d66087d"
inpaintingVersion = "e5a34f913de0adc560d20e002c45ad43a80031b62caacc3d84010c6b6a64870c"
txt2imgVersion = "6359a0cab3ca6e4d3320c33d79096161208e9024d174b2311e5a21b6c7e1131c"

def screenCap(viewPortName, i_w=512, i_h=512):
    maximizedID = None
    allVP = Rhino.RhinoDoc.ActiveDoc.Views.GetViewList(True, False)
    targetVP = None
    for i, vp in enumerate(allVP):
        if vp.ActiveViewport.Name == viewPortName:
            print i
            targetVP = vp
        if vp.Maximized == True:
            maximizedID = i
    if targetVP == None:
        print "asd"
        targetVP = allVP[0] 
    imageDim = System.Drawing.Size(i_w, i_h)
    
    idd = Rhino.Display.DisplayModeDescription.Id
    dm = Rhino.Display.DisplayModeDescription.GetDisplayModes()

    # get prefered render mode
    for obj in dm:
        if obj.LocalName == 'Rendered':
            dm = obj
    imageCap = targetVP.CaptureToBitmap(imageDim)#Rhino.Display.RhinoView.CaptureToBitmap(cam_view, imageDim, dm)
    if maximizedID != None:
        allVP[maximizedID].Maximized = True
    
    return imageCap

def convertBM(bm):
    # encodes bitmap to b64
    converter = System.Drawing.ImageConverter()
    bytes_ = converter.ConvertTo(bm, typeof(System.Array[System.Byte]))
    imageB64 = System.Convert.ToBase64String(
        bytes_,
        System.Base64FormattingOptions.None)
    return imageB64

def UrlOpen(uri, parameters=None):
    request = WebRequest.Create(uri)
    request.Timeout = 2500
    
    if parameters is not None:
        print parameters
        
        request.ContentType = "application/json"
        request.Accept = "*/*"
        request.Method = "POST"   
        request.Headers.Add("Authorization: Token {token}".format(token=authToken))
        bytes = Encoding.ASCII.GetBytes(parameters)
        request.ContentLength = bytes.Length
        reqStream = request.GetRequestStream()
        reqStream.Write(bytes, 0, bytes.Length)
        reqStream.Close()
    response = request.GetResponse()
    responseTxt = StreamReader(response.GetResponseStream()).ReadToEnd()
    respJson = json.loads(str(responseTxt))
    resURL = respJson["urls"]["get"]
    
    # fetch inference result once its finished
    
    time.sleep(3.5) # inference takes at least 4s
    inferenceFinished = False
    maxCnt = 50
    cnt =0
    logCollection = []
    while not inferenceFinished and cnt <= maxCnt:
        awnserURL = resURL
        requestResult = WebRequest.Create(awnserURL)
        requestResult.Timeout = 35000
        requestResult.ContentType = "application/json"
        requestResult.Method = "GET"   #not work for get method
        requestResult.Headers.Add("Authorization: Token {token}".format(token=authToken))
        reqResultStream = requestResult.GetResponse()
        resultResult = StreamReader(reqResultStream.GetResponseStream()).ReadToEnd()
        respJson = json.loads(str(resultResult))
        if respJson["completed_at"] != None:
            inferenceFinished = True
        print("inference in progress...")
        cnt += 1
        time.sleep(0.2)
    sc.sticky["API_log"].append(str(time.time()) + "----- errors:" + str(respJson["error"]))
    if cnt >= maxCnt:
        log = "time out"
        sc.sticky["API_log"].append("time out")
    try:
        print "hello"
        imgURL =  respJson["output"][0]
        # get result image
        client =  WebClient()
        stream = client.OpenRead(imgURL)
        bm = Bitmap(stream)
        return bm
    except:
        return "an error occured"
    
    return bm


# choose best suiting model version
print("initImage: ", initImage, "maskImage: ", maskImage)
version = txt2imgVersion
if initImage != None:
    version = img2imgVersion
if maskImage != None:
    version= inpaintingVersion

# assemble model instruction and input data ------------------------------------
requestContent = {"version": version}
modelInput = {"prompt":prompt}
if initImage != None:
    imgDims = initImage.Size
    modelInput["width"] = imgDims.Width
    modelInput["height"] = imgDims.Height
    b64IMG = "data:image/png;base64," + convertBM(initImage)
    modelInput["image"] = b64IMG
if maskImage != None and maskImage != "Null" and initImage != None:
    b64IMG_mask = "data:image/png;base64," + convertBM(maskImage)
    modelInput["mask"] = b64IMG_mask
if negative_prompt != None and negative_prompt != "":
     modelInput["negative_prompt"] = negative_prompt
if scheduler != None and scheduler != "":
    modelInput["scheduler"] = scheduler
if promptStrength != None:
    if promptStrength > 1:
        promptStrength = 1
    elif promptStrength <0.01:
        promptStrength= 0.01
    modelInput["prompt_strength"] = promptStrength
if steps != None:
    modelInput["num_inference_steps"] = steps
if guidance != None:
    if guidance < 1:
        guidance = 1
    elif guidance >20:
        guidance= 20
    modelInput["guidance_scale"] = guidance
if seed != None:
    modelInput["seed"] = seed

requestContent["input"] = modelInput
requestContentStr =  str(requestContent).replace("'", '"')

# run model
if run:
    sc.sticky["resultImage"] = UrlOpen("https://api.replicate.com/v1/predictions",requestContentStr)

res = sc.sticky["resultImage"]
log = sc.sticky["API_log"]
# ---------- end ghpython_script_7 ----------

# ----
image = Data(ghpython_script_7.res)
image_viewer = ImageViewer(Image=ghpython_script_6.image_out)

# ---- group: adjust brightness and contrast
c_script_3 = CSharpScript(adjustImage=adj_image, img=image, brigthness=Slider(0.01, range=0..1), contrast=contrast)  # -> adjImage; inputs adjustImage: Boolean, brigthness: Double, contrast: Double
# ---------- c_script_3: C# ----------
    Image originalImage = img as Image;
    var adjustedImage = new Bitmap(originalImage);
    float adjustedBrightness = (float) brigthness;
    float adjContrast = (float) contrast;

    float[][] ptsArray = {
      new float[] {adjContrast, 0, 0, 0, 0}, // scale red
      new float[] {0, adjContrast, 0, 0, 0}, // scale green
      new float[] {0, 0, adjContrast, 0, 0}, // scale blue
      new float[] {0, 0, 0, 1.0f, 0}, // don't scale alpha
      new float[] {adjustedBrightness, adjustedBrightness, adjustedBrightness, 0, 1}};

    ImageAttributes imageAttributes = new ImageAttributes();
    imageAttributes.ClearColorMatrix();
    imageAttributes.SetColorMatrix(new ColorMatrix(ptsArray), ColorMatrixFlag.Default, ColorAdjustType.Bitmap);
    imageAttributes.SetGamma(1.0f, ColorAdjustType.Bitmap);
    Graphics g = Graphics.FromImage(adjustedImage);
    g.DrawImage(originalImage, new Rectangle(0, 0, adjustedImage.Width, adjustedImage.Height)
      , 0, 0, originalImage.Width, originalImage.Height,
      GraphicsUnit.Pixel, imageAttributes);
    if (adjustImage){
      adjImage = adjustedImage;
    } else {
      adjImage = originalImage;
    }
# ---------- end c_script_3 ----------

# ---- group: save resultImage
ghpython_script_8 = GhPythonScript(run=run_4, update=update_image, pth=concatenate_2, initImg=stream_gate_3.Target1, bm=c_script_3)  # -> imgPth
# ---------- ghpython_script_8: Python ----------
__author__ = "DueringS"
__version__ = "2022.10.30"
import copy
import rhinoscriptsyntax as rs
import scriptcontext as sc
import time
import System.Drawing.Bitmap as Bitmap
import System.Drawing.Imaging.ImageFormat as ImageFormat
print time.localtime()[4]

if "currentImagePath" not in sc.sticky.keys():
    sc.sticky["currentImagePath"] = None

curTimeDate = time.localtime()

year = str(curTimeDate[0])[2:]
month = str(curTimeDate[1])
day  = str(curTimeDate[2])
hr  = str(curTimeDate[3])
min  = str(curTimeDate[4])
sec  = str(curTimeDate[5])

if len(day) < 2:
    day = "0" + day
if len(month) < 2:
    month = "0" + month

imgName = year + ""  +  month + "" +day + "-" + hr + min+sec+  "_SD_output.png"
imgNameInit = year + ""  +  month + "" +day + "-" + hr + min+sec+  "_SD_input.png"


imgPth = pth + "\\" + imgName
imgPthInit = pth + "\\" + imgNameInit

initImgCopy = copy.deepcopy(initImg)



if run or update:
    try:
        bm.Save(imgPth, ImageFormat.Png)
        sc.sticky["currentImagePath"] = imgPth
    except:
        pass
    try:
        initImgCopy.Save(imgPthInit, ImageFormat.Png)
    except:
        pass
imgPth = sc.sticky["currentImagePath"]
# ---------- end ghpython_script_8 ----------

# ----
logs = Panel(ghpython_script_7.log)
result_image = Data(ghpython_script_7.res)
input_image = Data(ghpython_script_6.image_out)
image_mask = Data(ghpython_script_6.mask_out)
result_image_path = Data(ghpython_script_8)

image_viewer_2 = ImageViewer(Image=c_script_2)

# ---- group: ensure image is updated before screencap
data_dam_9 = DataDam(DataA=result_image_path, BufferDelay=10000000, BufferMode=2)

# ---- group: map image to gh geometry
geometry_2 = Geometry(geometry)
boxmapping = BoxMapping(Mesh=geometry_2, Box=geometry_2)
custom_preview_materials = CustomPreviewMaterials(Geometry=boxmapping, DiffuseColor=RGB(255, 255, 255), DiffuseBitmap=data_dam_9)

# ----
image_viewer_3 = ImageViewer(Image=ghpython_script_7.res)

# ---- group: get result image
create_image = CreateImage(ImageSource="asd", ImageWidth=600, ImageHeight=400)
set_image = SetImage(ImageToModify=create_image, NewImagePath=result_image_path)

# ----
merge_11 = Merge(
    Data2=flatten(create_text_box_5),
    Data3=create_text_box_4,
    Data4=flatten(create_stack_6),
    Data5=flatten(create_view_box_4),
    Data6=flatten(create_image),
    Data7=flatten(merge_9))
tabbed_view = TabbedView(TabNames=panel_12, TabTextSize=12, Tab0=flatten(merge_11), Tab1=flatten(merge_10))
set_tabbed_view = SetTabbedView(TabbedView=tabbed_view, SetTabIndex=1)

show_window = BooleanToggle(True)
title_bar = BooleanToggle(True)
launch_window = LaunchWindow(Show=show_window, Name="Stable Diffusion", Width=450, Height=600, ChildStatus=0, EnableHorizScroll=False)
add_elements = AddElements(Window=launch_window, Elements=flatten(tabbed_view), DoVLChecking=True)  # -> AddedElements, ElementNames
set_window_properties = SetWindowProperties(Window=launch_window, ShowTitleBar=title_bar, ScaleFactor=1)

# ==== cluster Cluster
y = ClusterInput()
ghpython_script = GhPythonScript(y=y)  # -> flatten(a)
# ---------- ghpython_script: Python ----------
__author__ = "DueringS"
__version__ = "2022.10.11"

import rhinoscriptsyntax as rs
import random


a = int(random.randint(0,9999999))
# ---------- end ghpython_script ----------
list_item = ListItem(List=flatten(ghpython_script), Index=0, Wrap=True)
i = ClusterOutput(list_item)
