# Grasshopper definition SD_Client_UI.gh (Grasshopper 1.0.7)
# plug-ins: Human UI, AviaryMacawGH

loadbm = GhPythonScript()  # -> bitmap
# ---------- loadbm: Python ----------
__author__ = "DueringS"
__version__ = "2021.08.19"

import rhinoscriptsyntax as rs
import System.Drawing.Bitmap as bm

bitmap = bm(imgPath)
# ---------- end loadbm ----------

# ----
# Human UI
# paste your token here to keep it
# permanently in the file
# add quick style tags of your
#  choice here
panel = Panel("Perspective")
strength = Slider(0.7, range=0.1..0.95)
iterations = Slider(60, range=1..75)
guidiance = Slider(20, range=1..20)
theshold = Slider(62, range=0..255)
paste_auth_token_here_to_keep_it_in_file = Panel("<get one from replicate.com>")
add_style_tags_here = Panel("""modernist
brutalist
Vienna
Newyork
Shanghai
Photography""")
image_width = Slider(512, range=512..1024)
image_height = Slider(512, range=512..1024)
get_gh_filepath = CSharpScript()  # -> A
# ---------- get_gh_filepath: C# ----------
A = GrasshopperDocument.FilePath;
# ---------- end get_gh_filepath ----------
ghpython_script = GhPythonScript(x=get_gh_filepath)  # -> a
# ---------- ghpython_script: Python ----------
__author__ = "DueringS"
__version__ = "2022.10.09"

import rhinoscriptsyntax as rs

temp = x.split("\\")[-1]
a = x.replace(temp, "")
print a
# ---------- end ghpython_script ----------
concatenate = Concatenate(FragmentA=ghpython_script, FragmentB="stable-diffusion")
panel_2 = Panel(concatenate)
ghpython_script_2 = GhPythonScript(x=add_style_tags_here)  # -> a
# ---------- ghpython_script_2: Python ----------
__author__ = "DueringS"
__version__ = "2022.10.13"

import rhinoscriptsyntax as rs
if x == "Photography":
    a = "Nikon, Canon"
else:
   a = x
# ---------- end ghpython_script_2 ----------
create_color_picker = CreateColorPicker(DefaultColor=ColourSwatch(SwatchColor=RGB(252, 0, 0)))
create_text_box = CreateTextBox(Label="viewport name", DefaultText=panel, UpdateButton=True, showLabel=True)
create_text_box_2 = CreateTextBox(Label="path to stable-diffusion folder", DefaultText=panel_2, UpdateButton=True, showLabel=True)
create_text_box_3 = CreateTextBox(Label="authentication token", DefaultText=paste_auth_token_here_to_keep_it_in_file, UpdateButton=True, showLabel=True)
create_text_box_4 = CreateTextBox(Label="prompt", DefaultText="a space cow is grazing on the moon", UpdateButton=True, showLabel=True)
create_button = CreateButton(ButtonName="run model!", ButtonStyle=0)
create_slider = CreateSlider(Slider=strength, ShowBounds=False, ShowTicks=False, ShowTooltip=False, ShowValLabel=True, showLabel=True)
create_slider_2 = CreateSlider(Slider=iterations, ShowBounds=False, ShowTicks=False, ShowTooltip=False, ShowValLabel=True, showLabel=True)
create_slider_3 = CreateSlider(Slider=image_width, ShowBounds=False, ShowTicks=False, ShowTooltip=False, ShowValLabel=True, showLabel=True)
create_slider_4 = CreateSlider(Slider=image_height, ShowBounds=False, ShowTicks=False, ShowTooltip=False, ShowValLabel=True, showLabel=True)
create_slider_5 = CreateSlider(Slider=theshold, ShowBounds=False, ShowTicks=False, ShowTooltip=False, ShowValLabel=True, showLabel=True)
create_slider_6 = CreateSlider(Slider=guidiance, ShowBounds=False, ShowTicks=False, ShowTooltip=False, ShowValLabel=True, showLabel=True)
create_toggle = CreateToggle(Default=False, Label=add_style_tags_here, OnLabel="    ", OffLabel="    ")
create_stack = CreateStack(UIElements=[create_slider, create_slider_6], Horizontal=False)
value_listener = ValueListener(Elements=create_text_box_4, SomeProperty=True)  # -> flatten(Values), Indices
value_listener_2 = ValueListener(Elements=create_toggle, SomeProperty=True)  # -> flatten(Values), Indices
value_listener_3 = ValueListener(Elements=create_slider, SomeProperty=True)  # -> Values, Indices
value_listener_4 = ValueListener(Elements=create_slider_2, SomeProperty=True)  # -> Values, Indices
value_listener_5 = ValueListener(Elements=create_slider_6, SomeProperty=True)  # -> Values, Indices
value_listener_6 = ValueListener(Elements=create_slider_3, SomeProperty=True)  # -> Values, Indices
value_listener_7 = ValueListener(Elements=create_slider_4, SomeProperty=True)  # -> Values, Indices
value_listener_8 = ValueListener(Elements=create_text_box, SomeProperty=True)  # -> Values, Indices
value_listener_9 = ValueListener(Elements=create_slider_5, SomeProperty=True)  # -> Values, Indices
value_listener_10 = ValueListener(Elements=create_color_picker, SomeProperty=True)  # -> Values, Indices
value_listener_11 = ValueListener(Elements=create_text_box_2, SomeProperty=True)  # -> Values, Indices
value_listener_12 = ValueListener(Elements=create_text_box_3, SomeProperty=True)  # -> Values, Indices
value_listener_13 = ValueListener(Elements=create_button, SomeProperty=True)  # -> Values, Indices
data_dam = DataDam(DataDataA=value_listener_3.Values, BufferDelay=20000000, BufferMode=2)
data_dam_2 = DataDam(DataDataA=value_listener_4.Values, BufferDelay=20000000, BufferMode=2)
data_dam_3 = DataDam(DataDataA=value_listener_5.Values, BufferDelay=20000000, BufferMode=2)
data_dam_4 = DataDam(DataDataA=value_listener_6.Values, BufferDelay=20000000, BufferMode=2)
data_dam_5 = DataDam(DataDataA=value_listener_7.Values, BufferDelay=20000000, BufferMode=2)
data_dam_6 = DataDam(DataDataA=value_listener_9.Values, BufferDelay=20000000, BufferMode=2)
data_dam_7 = DataDam(DataDataA=value_listener_10.Values, BufferDelay=10000000, BufferMode=2)
ghpython_script_3 = GhPythonScript(prompt=value_listener.Values, txt=ghpython_script_2, state=value_listener_2.Values)  # -> a; inputs txt: list, state: list
# ---------- ghpython_script_3: Python ----------
__author__ = "DueringS"
__version__ = "2022.10.09"

import rhinoscriptsyntax as rs

promptFinal = prompt

for i, t in enumerate(txt):
    if state[i] == True:
        promptFinal += ", " + t

a = promptFinal
# ---------- end ghpython_script_3 ----------
create_wrappanel = CreateWrapPanel(UIElements=create_toggle, Horizontal=True)
merge = Merge(Data1=create_button)
panel_3 = Panel("""To use the image mask mode you have to create a layer with the name "IMG_MASK" and assing an "Emission" material to it, with a color that is easy to seperate from the rest of the scene (similar to how blue or green-screen work). 
Now, you can use geometry drawn on this layer to create the mask.""")
create_text_block = CreateTextBlock(Text=panel_3, TextSize=8, Justification=1)
create_view_box = CreateViewBox(UIElements=create_wrappanel, Width=350, Height=60)
create_expander = CreateExpander(UIElements=create_text_box_3, Header="Auth. Token (keep it secret)", Open=False)
create_separator = CreateSeparator(Thickness=0.5, Horizontal=True, Color=RGB(0, 0, 0), Width=300, Height=20)
create_separator_2 = CreateSeparator(Thickness=0.5, Horizontal=True, Color=RGB(33, 33, 33), Width=300, Height=50)
create_label = CreateLabel(LabelText="Additional model Settings", LabelSize=12, Justification=1)
create_label_2 = CreateLabel(LabelText="Image Mask Settings", LabelSize=12, Justification=1)
merge_2 = Merge(
    Data1=create_expander,
    Data2=create_text_box,
    Data3=create_text_box_2,
    Data4=create_separator,
    Data5=create_label,
    Data6=create_slider_3,
    Data7=create_slider_4,
    Data8=create_slider_2,
    Data9=create_separator_2,
    Data10=create_label_2,
    Data11=create_slider_5,
    Data12=create_color_picker,
    Data13=create_text_block)
adjust_element_appearance = AdjustElementAppearance(ElementsToAdjust=merge_2, Foreground=RGB(0, 0, 0), Background=RGB(255, 255, 255), FontSize=12)
panel_4 = Panel("""model
settings""")

# ---- group: cap screen & call model
# Stable Diffusion
run = Data(value_listener_13.Values)
localdir = Data(ghpython_script)
prompts = Data(ghpython_script_3)
promptstrength = Data(data_dam)
steps = Data(data_dam_2)
guidance = Data(data_dam_3)
viewport_name = Data(value_listener_8.Values)
authtoken = Data(value_listener_12.Values)
threshold = Data(data_dam_6)
keycolor = Data(data_dam_7)
width = Data(data_dam_4)
height = Data(data_dam_5)
ghpython_script_4 = GhPythonScript(y=run)  # -> flatten(a)
# ---------- ghpython_script_4: Python ----------
__author__ = "DueringS"
__version__ = "2022.10.11"

import rhinoscriptsyntax as rs
import random


a = int(random.randint(0,9999999))
# ---------- end ghpython_script_4 ----------
panel_5 = Panel(viewport_name)
localdir_2 = Data(localdir)
panel_6 = Panel(prompts)
list_item = ListItem(List=flatten(ghpython_script_4), Index=0, Wrap=True)
concatenate_2 = Concatenate(FragmentA=localdir_2, FragmentB="results")

# ---- group: cap screen & call model / screen cap
ghpython_script_5 = GhPythonScript(vpName=panel_5, width=width, height=height, trigger=list_item)  # -> image_out, mask_out; inputs width: Int32, height: Int32
# ---------- ghpython_script_5: Python ----------
__author__ = "DueringS"
__version__ = "2022.10.30"

import rhinoscriptsyntax as rs
import scriptcontext as sc
import Rhino
import System
import Rhino.RhinoDoc as rhDoc
import scriptcontext
from clr import GetClrType as typeof


def screenCap(viewPortName, i_w=512, i_h=512):
    maximizedID = None
    allVP = Rhino.RhinoDoc.ActiveDoc.Views.GetViewList(True, False)
    targetVP = None
    for i, vp in enumerate(allVP):
        if vp.ActiveViewport.Name == viewPortName:
            print i
            targetVP = vp
        if vp.Maximized == True:
            maximizedID = i
    print dir(allVP[0])
    if targetVP == None:
        print "asd"
        targetVP = allVP[0] 
    imageDim = System.Drawing.Size(i_w, i_h)
    
    idd = Rhino.Display.DisplayModeDescription.Id
    dm = Rhino.Display.DisplayModeDescription.GetDisplayModes()

    # get prefered render mode
    for obj in dm:
        if obj.LocalName == 'Rendered':
            dm = obj
                            
    imageCap = targetVP.CaptureToBitmap(imageDim)
    if maximizedID != None:
        allVP[maximizedID].Maximized = True
    
    return imageCap

def convertBM(bm):
    # encodes bitmap to b64
    converter = System.Drawing.ImageConverter()
    bytes_ = converter.ConvertTo(bm, typeof(System.Array[System.Byte]))
    imageB64 = System.Convert.ToBase64String(
        bytes_,
        System.Base64FormattingOptions.None)
    return imageB64

# ensure correct image size
if width != None:
    if width < 512:
        width = 512
    elif width >1024:
        width= 1024
else:
    width = 512

if height != None:
    if height > 768 and width > 1024:
        height = 768
    elif height > 1024:
        height = 1024
    elif height < 512:
        height= 512
else:
    height = 512

# handle IMG_MASK mode
sc.doc = rhDoc.ActiveDoc

maskImage = None
mainImage = None

curLayer = scriptcontext.doc.Layers.CurrentLayer

try:
    postProcessFlag = False
    if curLayer.Name == "IMG_MASK":
        postProcessFlag = True
        # create fake layer 
        dummyIndex = scriptcontext.doc.Layers.Add("justPassingBy", System.Drawing.Color.Black)
        # set dummy layer active 
        scriptcontext.doc.Layers.SetCurrentLayerIndex(dummyIndex, True)
    
    rs.LayerVisible("IMG_MASK",True)
    maskImage = screenCap(vpName,width,height)
    rs.LayerVisible("IMG_MASK",False)
    mainImage =screenCap(vpName,width,height)

    if postProcessFlag:
        scriptcontext.doc.Layers.SetCurrentLayerIndex(curLayer.Index, True)
        scriptcontext.doc.Layers.Delete(dummyIndex, True)
    rs.LayerVisible("IMG_MASK",True)
except:
    mainImage =screenCap(vpName,width,height)

image_out = mainImage
mask_out = maskImage
# ---------- end ghpython_script_5 ----------

# ---- group: cap screen & call model / create image mask
# Wrap this into a Hops definition to run it async!
c_script = CSharpScript(img=ghpython_script_5.mask_out, threshold=threshold, keyColor=keycolor)  # -> Image_mask; inputs threshold: Int32, keyColor: Color
# ---------- c_script: C# usings ----------
using System.Drawing;
using System.Drawing.Drawing2D;
using System.Drawing.Imaging;
using System.IO;
using System.Linq;
# ---------- c_script: C# ----------
    // mask image by color, create black/white mask

    Image image = img as Image;
    // color filter
    int hr = (int) keyColor.R;
    int hg = (int) keyColor.G;
    int hb = (int) keyColor.B;

    int highR = hr + threshold;
    int lowR = hr - threshold;

    int highG = hg + threshold;
    int lowG = hg - threshold;

    int highB = hb + threshold;
    int lowB = hb - threshold;

    if (highR > 255){highR = 255;}
    if (lowR < 0){lowR = 0;}

    if (highG > 255){highG = 255;}
    if (lowG < 0){lowG = 0;}

    if (highB > 255){highB = 255;}
    if (lowB < 0){lowB = 0;}



    var imageAttr = new ImageAttributes();
    Color lowerColor = Color.FromArgb(lowR, lowG, lowB);
    Color upperColor = Color.FromArgb(highR, highG, highB);
    imageAttr.SetColorKey(
      lowerColor,
      upperColor,
      ColorAdjustType.Default
      );


    // Draw the image with the color key set.
    Rectangle rect = new Rectangle(0, 0, image.Width, image.Height);

    var output = new Bitmap(image.Width, image.Height);
    using (var gfx = Graphics.FromImage(output))
    {
      gfx.SmoothingMode = SmoothingMode.AntiAlias;
      gfx.DrawImage(
        image,
        new Rectangle(0, 0, image.Width, image.Height),
        0,
        0,
        image.Width,
        image.Height,
        GraphicsUnit.Pixel,
        imageAttr);

    }


    float[][] ptsArray = {
      new float[] {1.0f, 0, 0, 0, 0},
      new float[] {0, 1.0f, 0, 0, 0}, 
      new float[] {0, 0, 1.0f, 0, 0},
      new float[] {0, 0, 0, 1.0f, 0},
      new float[] {1.0f, 1.0f, 1.0f, 0, 1}};

    ImageAttributes imageAttributes = new ImageAttributes();
    imageAttributes.ClearColorMatrix();

    imageAttributes.SetColorMatrix(new ColorMatrix(ptsArray), ColorMatrixFlag.Default, ColorAdjustType.Bitmap);

    var outInverted = new Bitmap(output.Width, output.Height);
    Graphics g = Graphics.FromImage(outInverted);
    Rectangle background = new Rectangle(0, 0, image.Width, image.Height);
    g.FillRectangle(Brushes.Black, background);
    g.DrawImage(output,
      new Rectangle(0, 0, output.Width, output.Height),
      0,
      0,
      output.Width, output.Height,
      GraphicsUnit.Pixel,
      imageAttributes);


    Image_mask = outInverted;
# ---------- end c_script ----------

# ---- group: cap screen & call model / call SD model
ghpython_script_6 = GhPythonScript(
    run=run,
    prompt=panel_6,
    initImage=ghpython_script_5.image_out,
    maskImage=c_script,
    promptStrength=promptstrength,
    steps=steps,
    guidance=guidance,
    authToken=authtoken)  # -> res, log
# ---------- ghpython_script_6: Python ----------
__author__ = "DueringS"
__version__ = "2022.10.30"

import rhinoscriptsyntax as rs
from System.Net import WebRequest
from System.IO import StreamReader
from System.Net import WebClient
from System.Text import Encoding
from System.Drawing import Bitmap
from clr import GetClrType as typeof
import Rhino
import System
import json
import time

if run == None:
    run = False


def screenCap(viewPortName, i_w=512, i_h=512):
    maximizedID = None
    allVP = Rhino.RhinoDoc.ActiveDoc.Views.GetViewList(True, False)
    targetVP = None
    for i, vp in enumerate(allVP):
        if vp.ActiveViewport.Name == viewPortName:
            print i
            targetVP = vp
        if vp.Maximized == True:
            maximizedID = i
    print dir(allVP[0])
    if targetVP == None:
        print "asd"
        targetVP = allVP[0] 
    imageDim = System.Drawing.Size(i_w, i_h)
    
    idd = Rhino.Display.DisplayModeDescription.Id
    dm = Rhino.Display.DisplayModeDescription.GetDisplayModes()

    # get prefered render mode
    for obj in dm:
        if obj.LocalName == 'Rendered':
            dm = obj
    imageCap = targetVP.CaptureToBitmap(imageDim)#Rhino.Display.RhinoView.CaptureToBitmap(cam_view, imageDim, dm)
    if maximizedID != None:
        allVP[maximizedID].Maximized = True
    
    return imageCap

def convertBM(bm):
    # encodes bitmap to b64
    converter = System.Drawing.ImageConverter()
    bytes_ = converter.ConvertTo(bm, typeof(System.Array[System.Byte]))
    imageB64 = System.Convert.ToBase64String(
        bytes_,
        System.Base64FormattingOptions.None)
    return imageB64

def UrlOpen(uri, parameters=None):
    request = WebRequest.Create(uri)
    request.Timeout = 2000
    
    if parameters is not None:
        print parameters
        
        request.ContentType = "application/json"
        request.Accept = "*/*"
        request.Method = "POST"   
        request.Headers.Add("Authorization: Token {token}".format(token=authToken))
        bytes = Encoding.ASCII.GetBytes(parameters)
        request.ContentLength = bytes.Length
        reqStream = request.GetRequestStream()
        reqStream.Write(bytes, 0, bytes.Length)
        reqStream.Close()
    response = request.GetResponse()
    responseTxt = StreamReader(response.GetResponseStream()).ReadToEnd()
    respJson = json.loads(str(responseTxt))
    resURL = respJson["urls"]["get"]
    
    # fetch inference result once its finished
    
    time.sleep(3.5) # inference takes at least 4s
    inferenceFinished = False
    maxCnt = 50
    cnt =0
    while not inferenceFinished and cnt <= maxCnt:
        awnserURL = resURL
        requestResult = WebRequest.Create(awnserURL)
        requestResult.Timeout = 2000
        requestResult.ContentType = "application/json"
        requestResult.Method = "GET"   #not work for get method
        requestResult.Headers.Add("Authorization: Token {token}".format(token=authToken))
        reqResultStream = requestResult.GetResponse()
        resultResult = StreamReader(reqResultStream.GetResponseStream()).ReadToEnd()
        respJson = json.loads(str(resultResult))
        if respJson["completed_at"] != None:
            inferenceFinished = True
        print("inference in progress...")
        cnt += 1
        time.sleep(0.2)
    print respJson
    log = respJson["error"]
    if cnt >= maxCnt:
        log = "time out"
    try:
        imgURL =  respJson["output"][0]
        print ("got result as response")
        # get result image
        client =  WebClient()
        stream = client.OpenRead(imgURL)
        bm = Bitmap(stream)
        return bm
    except:
        return "an error occured"
    return bm


if version == None:
    version = "5b703f0fa41880f918ab1b12c88a25b468c18639be17515259fb66a83f4ad0a4"
# assemble model instruction and input data ------------------------------------
requestContent = {"version": version}
modelInput = {"prompt":prompt}
if initImage != None:
    imgDims = initImage.Size
    modelInput["width"] = imgDims.Width
    modelInput["height"] = imgDims.Height
    b64IMG = "data:image/png;base64," + convertBM(initImage)
    modelInput["init_image"] = b64IMG
if maskImage != None and maskImage != "Null" and initImage != None:
    b64IMG_mask = "data:image/png;base64," + convertBM(maskImage)
    modelInput["mask"] = b64IMG_mask
if promptStrength != None:
    if promptStrength > 1:
        promptStrength = 1
    elif promptStrength <0.01:
        promptStrength= 0.01
    modelInput["prompt_strength"] = promptStrength
if steps != None:
    modelInput["num_inference_steps"] = steps
if guidance != None:
    if guidance < 1:
        guidance = 1
    elif guidance >20:
        guidance= 20
    modelInput["guidance_scale"] = guidance
if seed != None:
    modelInput["seed"] = seed

requestContent["input"] = modelInput
requestContentStr =  str(requestContent).replace("'", '"')

# run model
log = "no errors"
if run:
    res = UrlOpen("https://api.replicate.com/v1/predictions",requestContentStr)
# ---------- end ghpython_script_6 ----------

# ---- group: cap screen & call model / save resultImage
ghpython_script_7 = GhPythonScript(pth=concatenate_2, bm=ghpython_script_6.res)  # -> imgPth
# ---------- ghpython_script_7: Python ----------
__author__ = "DueringS"
__version__ = "2022.10.30"

import rhinoscriptsyntax as rs
import time
import System.Drawing.Bitmap as Bitmap
import System.Drawing.Imaging.ImageFormat as ImageFormat
print time.localtime()[4]



curTimeDate = time.localtime()

year = str(curTimeDate[0])[2:]
month = str(curTimeDate[1])
day  = str(curTimeDate[2])
hr  = str(curTimeDate[3])
min  = str(curTimeDate[4])
sec  = str(curTimeDate[5])

if len(day) < 2:
    day = "0" + day
if len(month) < 2:
    month = "0" + month

imgName = year + ""  +  month + "" +day + "-" + hr + min+sec+  "SD.png"

imgPth = pth + "\\" + imgName
bm.Save(imgPth, ImageFormat.Png)
# ---------- end ghpython_script_7 ----------

# ---- group: cap screen & call model (continued)
dr = DataRecorder(ghpython_script_6.res, DataLimit=2, RecordData=True)
dr_2 = DataRecorder(ghpython_script_7, DataLimit=1, RecordData=True)
list_item_2 = ListItem(List=dr, Index=0, Wrap=True)  # -> Item1, Item
result_image_path = Data(dr_2)
input_image = Data(ghpython_script_5.image_out)
image_mask = Data(ghpython_script_5.mask_out)
result_image = Data(list_item_2.Item)

# ----
image_viewer = ImageViewer(Image=input_image)
image_viewer_2 = ImageViewer(Image=c_script)

# ---- group: get result image
create_image = CreateImage(ImageSource="asd", ImageWidth=600, ImageHeight=400)
set_image = SetImage(ImageToModify=create_image, NewImagePath=result_image_path)

# ----
image_viewer_3 = ImageViewer(Image=result_image_path)

merge_3 = Merge(
    Data2=flatten(create_text_box_4),
    Data3=flatten(create_stack),
    Data4=flatten(create_view_box),
    Data5=flatten(create_image),
    Data6=flatten(merge))
tabbed_view = TabbedView(TabNames=panel_4, TabTextSize=12, Tab0=flatten(merge_3), Tab1=flatten(merge_2))

show_window = BooleanToggle(True)
title_bar = BooleanToggle(True)
launch_window = LaunchWindow(Show=show_window, Name="Stable Diffusion", Width=450, Height=600, ChildStatus=0, EnableHorizScroll=False)
add_elements = AddElements(Window=launch_window, Elements=flatten(tabbed_view), DoVLChecking=True)  # -> AddedElements, ElementNames
set_window_properties = SetWindowProperties(Window=launch_window, ShowTitleBar=title_bar, ScaleFactor=1)

set_tabbed_view = SetTabbedView(TabbedView=tabbed_view, SetTabIndex=1)
